# Grasshopper definition WAFFLE STRUCTURES.gh (Grasshopper 1.0.8)
# plug-ins: Pufferfish, OpenNest, NGon_RH8

number_slider = Slider(0.2, range=0..0.2)

number_slider_2 = Slider(0.4, range=0..1)
number_slider_3 = Slider(0.8, range=0..2)

# ----
# Creación rectangulos planchas
number_slider_4 = Slider(0.1, range=0..1)
addition = Addition(A=number_slider_3, B=number_slider_4)
addition_2 = Addition(A=number_slider_2, B=number_slider_4)
rectangle = Rectangle(Plane=PlaneXY(0, 0, 0), XSize=addition, YSize=addition_2, Radius=0)  # -> Rectangle, Length
rectangle_2 = Rectangle(Plane=PlaneXY(0, 0, 0), XSize=number_slider_3, YSize=number_slider_2, Radius=0)  # -> Rectangle, Length
rectangular_array = RectangularArray(Geometry=rectangle_2.Rectangle, Cell=rectangle.Rectangle, XCount=3, YCount=Slider(3, range=0..10))  # -> Geometry, Transform

# ----
# CREATE SURFACE FROM CIRCLE
# Creación de geometría inicial
point = Point(<point referenced from the Rhino model>)
plane_normal = PlaneNormal(Origin=point, ZAxis=Vector(0, 0, 1))
circle = Circle(Plane=plane_normal, Radius=Slider(0.6, range=0..1))
divide_curve = DivideCurve(Curve=circle, Count=Slider(12, range=0..20), Kinks=False)  # -> Points, Tangents, Parameters
# CREATE SURFACE FROM POINTS
# IMPORT SURFACE FROM REVIT
# SURFACE CREATION
number_slider_5 = Slider(0, range=0..100)
number_slider_6 = Slider(2, range=0..10)
list_length = ListLength(List=divide_curve.Points)
division = Division(A=list_length, B=number_slider_6)

# ----
# Subir puntos con índice impar
number_slider_7 = Slider(0.3, range=0..1)
series = Series(Start=number_slider_5, Step=number_slider_6, Count=division)
cull_index = CullIndex(List=divide_curve.Points, Indices=series, Wrap=True)
vector_xyz = VectorXYZ(XComponent=0, YComponent=0, ZComponent=number_slider_7)  # -> Vector, Length
move = Move(Geometry=cull_index, Motion=vector_xyz.Vector)  # -> Geometry, Transform

# ----
# Subir punto central
division_2 = Division(A=number_slider_7, B=number_slider_6)
vector_xyz_2 = VectorXYZ(XComponent=0, YComponent=0, ZComponent=division_2)  # -> Vector, Length
move_2 = Move(Geometry=point, Motion=vector_xyz_2.Vector)  # -> Geometry, Transform

series_2 = Series(Start=Slider(1, range=0..100), Step=number_slider_6, Count=division)
cull_index_2 = CullIndex(List=divide_curve.Points, Indices=series_2, Wrap=True)

line = Line(StartPoint=[move.Geometry, cull_index_2], EndPoint=move_2.Geometry)
weave = Weave(Pattern=[0, 1], Stream0=cull_index_2, Stream1=move.Geometry, NullGaps=False)
interpolate = Interpolate(Vertices=weave, Degree=3, Periodic=True, KnotStyle=1)  # -> Curve, Length, Domain
patch = Patch(Curves=[interpolate.Curve, line], Spans=20, Flexibility=1, Trim=True)

# ----
# Mesh inicial
number_slider_8 = Slider(0.04, range=0..0.1)
# Costillas iniciales
# Obtención de planos de trabajo para las costillas
offsrf = OffsetSurface(Surface=patch, Distance=number_slider_8, BothSides=0, CreateSolid=True)

bounding_box = BoundingBox(Content=offsrf, Plane=PlaneXY(0, 0, 0))  # -> Box, Box_2
deconstruct_box = DeconstructBox(Box=bounding_box.Box)  # -> Plane, X, Y, Z
deconstruct_brep = DeconstructBrep(Brep=bounding_box.Box)  # -> Faces, Edges, Vertices
list_item = ListItem(List=deconstruct_brep.Faces, Index=0, Wrap=True)
list_item_2 = ListItem(List=deconstruct_brep.Faces, Index=Slider(1, range=0..1), Wrap=True)
area = Area(Geometry=list_item)  # -> Area, Centroid
area_2 = Area(Geometry=list_item_2)  # -> Area, Centroid
evaluate_surface = EvaluateSurface(Surface=list_item, Point=area.Centroid)  # -> Point, Normal, UDirection, VDirection, Frame
evaluate_surface_2 = EvaluateSurface(Surface=list_item_2, Point=area_2.Centroid)  # -> Point, Normal, UDirection, VDirection, Frame

# ----
# Costillas iniciales líneas
contour = Contour(Shape=offsrf, Point=area.Centroid, Direction=evaluate_surface.Normal, Distance=number_slider)
contour_2 = Contour(Shape=offsrf, Point=area_2.Centroid, Direction=evaluate_surface_2.Normal, Distance=number_slider)

cls = Closed(Curve=contour_2)  # -> Closed, Periodic
# Superficies reconstruidas
cls_2 = Closed(Curve=contour)  # -> Closed, Periodic
dispatch = Dispatch(List=contour_2, DispatchPattern=cls.Closed)  # -> ListA, ListB
dispatch_2 = Dispatch(List=contour, DispatchPattern=cls_2.Closed)  # -> ListA, ListB
crv = Curve(dispatch.ListA)
crv_2 = Curve(dispatch_2.ListA)
explode = Explode(Curve=crv, Recursive=False)  # -> Segments, Vertices
explode_2 = Explode(Curve=crv_2, Recursive=False)  # -> Segments, Vertices
item = ListItem(List=explode.Segments, Index=0, Wrap=True)
item_2 = ListItem(List=explode.Segments, Index=1, Wrap=True)
item_3 = ListItem(List=explode.Segments, Index=2, Wrap=True)
item_4 = ListItem(List=explode.Segments, Index=3, Wrap=True)
item_5 = ListItem(List=explode_2.Segments, Index=0, Wrap=True)
item_6 = ListItem(List=explode_2.Segments, Index=1, Wrap=True)
item_7 = ListItem(List=explode_2.Segments, Index=2, Wrap=True)
item_8 = ListItem(List=explode_2.Segments, Index=3, Wrap=True)
edgesrf = EdgeSurface(CurveA=item, CurveB=item_2, CurveC=item_3, CurveD=item_4)
edgesrf_2 = EdgeSurface(CurveA=item_5, CurveB=item_6, CurveC=item_7, CurveD=item_8)

number_slider_9 = Slider(0.003, range=0..0.01)
Y = UnitY(Factor=number_slider_9)
X = UnitX(Factor=number_slider_9)
move_3 = Move(Geometry=simplify(edgesrf_2), Motion=Y)  # -> Geometry, Transform
extr = Extrude(Base=simplify(crv_2), Direction=Y)
# Tamaño plancha
# Tamaño plancha
# Añadir grosor a costillas
area_3 = Area(Geometry=dispatch_2.ListA)  # -> Area, Centroid
brep = Brep(simplify(edgesrf_2))
move_4 = Move(Geometry=simplify(edgesrf), Motion=X)  # -> Geometry, Transform
extr_2 = Extrude(Base=simplify(crv), Direction=X)
brep_2 = Brep(simplify(edgesrf))
area_4 = Area(Geometry=dispatch.ListA)  # -> Area, Centroid
xz = XZPlane(Origin=area_3.Centroid)
join = BrepJoin(Breps=[extr, move_3.Geometry, brep])  # -> Breps, Closed
xz_2 = XZPlane(Origin=area_4.Centroid)
join_2 = BrepJoin(Breps=[extr_2, move_4.Geometry, brep_2])  # -> Breps, Closed

# ----
# Costillas iniciales
# Superficie
# Sólido
# Superficie
# Sólido
brep_3 = Brep(edgesrf_2)
brep_4 = Brep(join.Breps)
brep_5 = Brep(edgesrf)
brep_6 = Brep(join_2.Breps)

plane = Plane(xz)
# Curvas de intersección
# entre costillas
brep_plane = BrepPlane(Brep=graft(brep_5), Plane=flatten(plane))  # -> Curves, Points
curve = Curve(brep_plane.Curves)

number_slider_10 = Slider(0.003, range=0..0.01)
# Creación de machihembrado
shift_paths = ShiftPaths(Data=curve, Offset=-1)
offset_curve = OffsetCurve(Curve=curve, Plane=plane, Distance=expr("x", number_slider_10), BothSides=expr("x", 0), Kinks=0, CapType=1)
boundary_surfaces = BoundarySurfaces(Edges=offset_curve)
offset_surface = OffsetSurface(Surface=boundary_surfaces, Distance=expr("+x", number_slider_10), BothSides=0, CreateSolid=True)
shift_paths_2 = ShiftPaths(Data=offset_surface, Offset=-2)
length = Length(Curve=shift_paths)
division_3 = Division(A=length, B=Slider(2, range=1..2))
unit_z = UnitZ(Factor=expr("+x", division_3))
unit_z_2 = UnitZ(Factor=expr("-x", division_3))
move_5 = Move(Geometry=shift_paths_2, Motion=unit_z)  # -> Geometry, Transform
move_6 = Move(Geometry=shift_paths_2, Motion=unit_z_2)  # -> Geometry, Transform
solid_difference = SolidDifference(BrepsA=flatten(brep_4), BrepsB=simplify(flatten(move_6.Geometry)))
solid_difference_2 = SolidDifference(BrepsA=brep_6, BrepsB=move_5.Geometry)

geometry = Geometry(move_5.Geometry)
geometry_2 = Geometry(move_6.Geometry)
surface = Surface(brep_5)
curve_2 = Curve(contour_2)
plane_2 = Plane(evaluate_surface_2.Frame)
curve_3 = Curve(contour)
plane_3 = Plane(evaluate_surface.Frame)
surface_2 = Surface(brep_3)

# ----
# Surface rib
clean_tree = CleanTree(RemoveNulls=True, RemoveInvalid=True, RemoveEmpty=False, Tree=geometry_2)
clean_tree_2 = CleanTree(RemoveNulls=True, RemoveInvalid=True, RemoveEmpty=False, Tree=geometry)
trim_tree = TrimTree(Tree=surface, Depth=1)
# Costillas con machihembrado - superficies
trim_tree_2 = TrimTree(Tree=surface_2, Depth=1)
trim_tree_3 = TrimTree(Tree=clean_tree, Depth=3)
trim_tree_4 = TrimTree(Tree=clean_tree_2, Depth=3)
match_tree = MatchTree(Tree=trim_tree, Guide=trim_tree_4)
match_tree_2 = MatchTree(Tree=trim_tree_2, Guide=trim_tree_3)
trim_solid = TrimSolid(Shape=match_tree_2, Cutters=flatten(geometry_2))
trim_solid_2 = TrimSolid(Shape=match_tree, Cutters=flatten(geometry))

# ----
# Tamaño plancha
clean_tree_3 = CleanTree(RemoveNulls=True, RemoveInvalid=True, RemoveEmpty=True, Tree=trim_solid_2)
deconstruct_brep_2 = DeconstructBrep(Brep=trim_solid)  # -> Faces, Edges, Vertices
deconstruct_brep_3 = DeconstructBrep(Brep=trim_solid_2)  # -> Faces, Edges, Vertices
# División de acuerdo a tamaño de placas
brep_7 = Brep(trim_solid)
flatten_tree = FlattenTree(Tree=trim_solid, Path="{0}")
bounding_box_2 = BoundingBox(Content=deconstruct_brep_2.Faces, Plane=PlaneXY(0, 0, 0))  # -> Box, Box_2
clean_tree_4 = CleanTree(RemoveNulls=True, RemoveInvalid=True, RemoveEmpty=True, Tree=deconstruct_brep_3.Faces)
brep_8 = Brep(clean_tree_3)
flatten_tree_2 = FlattenTree(Tree=clean_tree_3, Path="{0}")
deconstruct_box_2 = DeconstructBox(Box=bounding_box_2.Box)  # -> Plane, X, Y, Z
bounding_box_3 = BoundingBox(Content=clean_tree_4, Plane=PlaneXY(0, 0, 0))  # -> Box, Box_2
deconstruct_box_3 = DeconstructBox(Box=bounding_box_3.Box)  # -> Plane, X, Y, Z
number_slider_11 = Slider(0.98, range=0..1)
deconstruct_domain = DeconstructDomain(Domain=deconstruct_box_2.X)  # -> Start, End
deconstruct_domain_2 = DeconstructDomain(Domain=deconstruct_box_2.Z)  # -> Start, End
subtraction = Subtraction(A=deconstruct_domain.End, B=deconstruct_domain.Start)
subtraction_2 = Subtraction(A=deconstruct_domain_2.End, B=deconstruct_domain_2.Start)
deconstruct_domain_3 = DeconstructDomain(Domain=deconstruct_box_3.Y)  # -> Start, End
deconstruct_domain_4 = DeconstructDomain(Domain=deconstruct_box_3.Z)  # -> Start, End
multiplication = Multiplication(A=number_slider_3, B=number_slider_11)
multiplication_2 = Multiplication(A=number_slider_2, B=number_slider_11)
flatten_tree_3 = FlattenTree(Tree=subtraction, Path="{0}")
flatten_tree_4 = FlattenTree(Tree=subtraction_2, Path="{0}")
subtraction_3 = Subtraction(A=deconstruct_domain_3.End, B=deconstruct_domain_3.Start)
subtraction_4 = Subtraction(A=deconstruct_domain_4.End, B=deconstruct_domain_4.Start)
division_4 = Division(A=flatten_tree_4, B=multiplication_2)
division_5 = Division(A=flatten_tree_3, B=multiplication)
flatten_tree_5 = FlattenTree(Tree=subtraction_3, Path="{0}")
flatten_tree_6 = FlattenTree(Tree=subtraction_4, Path="{0}")
round = Round(Number=division_5)  # -> Nearest, Floor, Ceiling
round_2 = Round(Number=division_4)  # -> Nearest, Floor, Ceiling
division_6 = Division(A=flatten_tree_6, B=multiplication_2)
division_7 = Division(A=flatten_tree_5, B=multiplication)
divide_domain² = DivideDomain²(Domain=flatten_tree, UCount=round.Ceiling, VCount=round_2.Ceiling)
round_3 = Round(Number=division_7)  # -> Nearest, Floor, Ceiling
round_4 = Round(Number=division_6)  # -> Nearest, Floor, Ceiling
isotrim = Isotrim(Surface=brep_7, Domain=divide_domain²)
divide_domain²_2 = DivideDomain²(Domain=flatten_tree_2, UCount=round_3.Ceiling, VCount=round_4.Ceiling)
isotrim_2 = Isotrim(Surface=brep_8, Domain=divide_domain²_2)

# ----
# Por qué se divide en tantas
# superficies pequeñas?
# Costillas divididas
# Costillas divididas
# Costillas divididas
deconstruct_brep_4 = DeconstructBrep(Brep=isotrim)  # -> Faces, Edges, Vertices
deconstruct_brep_5 = DeconstructBrep(Brep=isotrim_2)  # -> Faces, Edges, Vertices
curve_4 = Curve(deconstruct_brep_4.Edges)
join_curves = JoinCurves(Curves=curve_4, Preserve=False)
curve_5 = Curve(deconstruct_brep_5.Edges)
join_curves_2 = JoinCurves(Curves=curve_5, Preserve=False)
shift_paths_3 = ShiftPaths(Data=join_curves, Offset=-2)
shift_paths_4 = ShiftPaths(Data=join_curves_2, Offset=-2)
match_tree_3 = MatchTree(Tree=shift_paths_3, Guide=trim_solid)
list_item_3 = ListItem(List=match_tree_3, Index=Slider(1, range=0..1), Wrap=True)
match_tree_4 = MatchTree(Tree=shift_paths_4, Guide=trim_solid_2)
surface_split = SurfaceSplit(Surface=trim_solid, Curves=match_tree_3)
index = Slider(2, range=0..20)
surface_split_2 = SurfaceSplit(Surface=trim_solid_2, Curves=match_tree_4)
index_2 = Slider(9, range=0..20)
deconstruct_brep_6 = DeconstructBrep(Brep=surface_split)  # -> Faces, Edges, Vertices
list_item_4 = ListItem(List=surface_split, Index=1, Wrap=True)
list_item_5 = ListItem(List=surface_split_2, Index=1, Wrap=True)
deconstruct_brep_7 = DeconstructBrep(Brep=surface_split_2)  # -> Faces, Edges, Vertices
join_curves_3 = JoinCurves(Curves=deconstruct_brep_6.Edges, Preserve=False)
list_item_6 = ListItem(List=flatten(join_curves_3), Index=index, Wrap=True)
xy_plane = XYPlane(Origin=Point(0, 0, 0))
xy_plane_2 = XYPlane(Origin=Point(0, 0, 0))
join_curves_4 = JoinCurves(Curves=deconstruct_brep_7.Edges, Preserve=False)
list_item_7 = ListItem(List=flatten(join_curves_4), Index=index_2, Wrap=True)

tree_statistics = TreeStatistics(Tree=surface_split_2)  # -> Paths, Length, Count
series_3 = Series(Start=0, Step=1, Count=tree_statistics.Count)
list_length_2 = ListLength(List=surface_split_2)
match_tree_5 = MatchTree(Tree=graft(series_3), Guide=list_length_2)
# Configuración texto
repeat_data = RepeatData(Data=match_tree_5, Length=list_length_2)
list_length_3 = ListLength(List=repeat_data)
series_4 = Series(Start=0, Step=1, Count=list_length_3)
concatenate = Concatenate(Fragment_A="A/", A=flatten(repeat_data), Fragment_B="/", B=flatten(series_4))

number_slider_12 = Slider(30, range=0..100)
divide_surface = DivideSurface(Surface=surface_split, UCount=number_slider_12, VCount=number_slider_12)  # -> Points, Normals, Parameters
# Obtención del plano de cada costilla
shift_paths_5 = ShiftPaths(Data=divide_surface.Points, Offset=-1)
curve_closest_point = CurveClosestPoint(Point=shift_paths_5, Curve=join_curves_3)  # -> Point, Parameter, Distance
sort_list = SortList(Keys=curve_closest_point.Distance, ValuesValuesA=shift_paths_5)  # -> Keys, reverse(ValuesValuesA)
list_item_8 = ListItem(List=sort_list.ValuesValuesA, Index=0, Wrap=True)
plane_origin = PlaneOrigin(Base=plane_3, Origin=list_item_8)

number_slider_13 = Slider(30, range=0..100)
divide_surface_2 = DivideSurface(Surface=surface_split_2, UCount=number_slider_13, VCount=number_slider_13)  # -> Points, Normals, Parameters
# Obtención del plano de cada costilla
shift_paths_6 = ShiftPaths(Data=divide_surface_2.Points, Offset=-1)
curve_closest_point_2 = CurveClosestPoint(Point=shift_paths_6, Curve=join_curves_4)  # -> Point, Parameter, Distance
sort_list_2 = SortList(Keys=curve_closest_point_2.Distance, ValuesValuesA=shift_paths_6)  # -> Keys, reverse(ValuesValuesA)
list_item_9 = ListItem(List=sort_list_2.ValuesValuesA, Index=0, Wrap=True)
plane_origin_2 = PlaneOrigin(Base=plane_2, Origin=list_item_9)

tree_statistics_2 = TreeStatistics(Tree=surface_split)  # -> Paths, Length, Count
series_5 = Series(Start=0, Step=1, Count=tree_statistics_2.Count)
list_length_4 = ListLength(List=surface_split)
match_tree_6 = MatchTree(Tree=graft(series_5), Guide=list_length_4)
# Configuración texto
repeat_data_2 = RepeatData(Data=match_tree_6, Length=list_length_4)
list_length_5 = ListLength(List=repeat_data_2)
series_6 = Series(Start=0, Step=1, Count=list_length_5)
concatenate_2 = Concatenate(Fragment_A="B/", A=flatten(repeat_data_2), Fragment_B="/", B=flatten(series_6))

text = Text(
    Location=flatten(plane_origin_2),
    Text=concatenate,
    Size=Slider(0.018, range=0..0.03),
    Bold=False,
    HorizontalAlignment=0,
    VerticalAlignment=0)
text_2 = Text(
    Location=flatten(plane_origin),
    Text=concatenate_2,
    Size=Slider(0.018, range=0..0.02),
    Bold=False,
    HorizontalAlignment=0,
    VerticalAlignment=0)
orient = Orient(Geometry=join_curves_4, Source=plane_2, Target=xy_plane_2)  # -> Geometry, Transform
orient_2 = Orient(Geometry=join_curves_3, Source=plane_3, Target=xy_plane)  # -> Geometry, Transform

# ----
# Preparar lista de curvas para OpenNest
crvs = Entwine(Branch0X=orient_2.Geometry, Branch1X=orient.Geometry, FlattenInputs=False)
area_5 = Area(Geometry=crvs)  # -> Area, Centroid
sort_list_3 = SortList(Keys=area_5.Area, ValuesValuesA=crvs)  # -> Keys, reverse(ValuesValuesA)
list_item_10 = ListItem(List=sort_list_3.ValuesValuesA, Index=0, Wrap=True)

# ----
# Organización de costillas sobre planchas
number_slider_14 = Slider(0.01, range=0..0.01)
opennest = OpenNest(
    Sheets=rectangular_array.Geometry,
    Geo=flatten(list_item_10),
    Spacing=number_slider_14,
    Placement=1,
    Tolerance=Slider(0.1, range=0..0.1),
    Rotations=Slider(3, range=0..10),
    Iterations=Slider(0, range=0..1),
    Seed=Slider(0, range=0..1),
    Reset=Button(),
    Run=Toggle(False))  # -> Sheets, Geo, ID, Transform, IDS
curve_6 = Curve(opennest.Sheets)
curve_7 = Curve(opennest.Geo)

curve_8 = Curve(crvs)
transform = Transform(graft(opennest.Transform))

# ----
# Orientar texto
orient_3 = Orient(Geometry=text_2, Source=plane_3, Target=xy_plane_2)  # -> Geometry, Transform
orient_4 = Orient(Geometry=text, Source=plane_2, Target=xy_plane_2)  # -> Geometry, Transform
entwine = Entwine(Branch0X=orient_3.Geometry, Branch1X=orient_4.Geometry, FlattenInputs=False)
transform_2 = Transform(Geometry=entwine, Transform=transform)

transform_3 = Transform(Geometry=curve_8, Transform=transform)
param_viewer = ParamViewer(curve_8)
